# Grasshopper definition MJProcGen.gh (Grasshopper 1.0.8)
# plug-ins: RhinoCodePluginGH

panel = Panel("C:\Users\Drew\Desktop\Projects\MJ Proc Gen gh\rulesets\trees.xml")
panel_2 = Panel("C:\Users\Drew\Desktop\Projects\MJ Proc Gen gh\rulesets\huts.xml")
panel_3 = Panel("C:\Users\Drew\Desktop\Projects\MJ Proc Gen gh\rulesets\random.xml")
panel_4 = Panel("C:\Users\Drew\Desktop\Projects\MJ Proc Gen gh\rulesets\rotref.xml")
panel_5 = Panel("C:\Users\Drew\Desktop\Projects\MJ Proc Gen gh\rulesets\walker.xml")
merge = Merge(Data1=panel, Data2=panel_2, Data3=panel_3, Data4=panel_4, Data5=panel_5)

# ---- group: Main
refresh = Button()
initiate_mj_main = CSharpScript(enableDebug=Toggle(True), refresh=refresh)  # -> debug, main
# ---------- initiate_mj_main: C# ----------
// Grasshopper Script Instance
#region Usings
using System;
#r "C:\Users\Drew\Desktop\Projects\Dev\MJ Proc Gen\MJ Proc Gen\bin\Debug\netstandard2.0\MJ_Proc_Gen.dll"
using System.Linq;
using System.Collections;
using System.Collections.Generic;
using System.Drawing;

using Rhino;
using Rhino.Geometry;

using Grasshopper;
using Grasshopper.Kernel;
using Grasshopper.Kernel.Data;
using Grasshopper.Kernel.Types;

using MJ_Proc_Gen;
#endregion

public class Script_Instance : GH_ScriptInstance
{
    private void RunScript(
	object _enableDebug,
	object _refresh,
	ref object debug,
	ref object main)
    {
        bool ed = (bool)_enableDebug;
        MJ_Main m = new MJ_Main(ed);
        debug = m.debug.DebugText;
        main = m;
    }
}
# ---------- end initiate_mj_main ----------

# ---- group: Run Parameters
number_slider = Slider(5000, range=0..1000000)
number_slider_2 = Slider(-997999, range=-1000000..1000000)
frame_1000 = Slider(1, range=1..1000)
frame_10000 = Slider(1, range=1..10000)
frame_100 = Slider(1, range=1..100)
refresh_2 = Button()

# ----
number_slider_3 = Slider(10, range=1..100)
number_slider_4 = Slider(10, range=1..100)
number_slider_5 = Slider(10, range=1..100)
mj_space = CSharpScript(
    main=initiate_mj_main.main,
    name="space",
    sizeX=number_slider_4,
    sizeY=number_slider_5,
    sizeZ=number_slider_3,
    defaultState="O")  # -> space
# ---------- mj_space: C# ----------
// Grasshopper Script Instance
#region Usings
using System;
#r "C:\Users\Drew\Desktop\Projects\Dev\MJ Proc Gen\MJ Proc Gen\bin\Debug\netstandard2.0\MJ_Proc_Gen.dll"
using System.Linq;
using System.Collections;
using System.Collections.Generic;
using System.Drawing;

using Rhino;
using Rhino.Geometry;

using Grasshopper;
using Grasshopper.Kernel;
using Grasshopper.Kernel.Data;
using Grasshopper.Kernel.Types;

using MJ_Proc_Gen;
#endregion

public class Script_Instance : GH_ScriptInstance
{
    private void RunScript(
	object _main,
	object _name,
	object _sizeX,
	object _sizeY,
	object _sizeZ,
	object _defaultState,
	ref object space)
    {
        string name = (string)_name;
        int x = Convert.ToInt32(_sizeX);
        int y = Convert.ToInt32(_sizeY);
        int z = Convert.ToInt32(_sizeZ);
        string defaultState = (string)_defaultState;
        MJ_Main main = (MJ_Main)_main;
        Space s = new Space(name, x, y, z, defaultState, main);
        space = s;
    }
}
# ---------- end mj_space ----------

add_spaces_and_rules = CSharpScript(main=initiate_mj_main.main, spaces=mj_space, rulesets=merge)  # -> debug, main; inputs spaces: list, rulesets: list
# ---------- add_spaces_and_rules: C# ----------
// Grasshopper Script Instance
#region Usings
using System;
#r "C:\Users\Drew\Desktop\Projects\Dev\MJ Proc Gen\MJ Proc Gen\bin\Debug\netstandard2.0\MJ_Proc_Gen.dll"
using System.Linq;
using System.Collections;
using System.Collections.Generic;
using System.Drawing;

using Rhino;
using Rhino.Geometry;

using Grasshopper;
using Grasshopper.Kernel;
using Grasshopper.Kernel.Data;
using Grasshopper.Kernel.Types;

using MJ_Proc_Gen;
#endregion

public class Script_Instance : GH_ScriptInstance
{
    private void RunScript(
	object _main,
	List<object> _spaces,
	List<object> _rulesets,
	ref object debug,
	ref object main)
    {
        MJ_Main m = (MJ_Main) _main;
        foreach (Space s in _spaces)
        {
            m.AddSpace(s);
        }
        foreach (string path in _rulesets)
        {
            m.AddRuleSet(path);
        }
        main = m;
        debug = m.debug.DebugText;
    }
}
# ---------- end add_spaces_and_rules ----------
panel_6 = Panel(initiate_mj_main.debug)
panel_7 = Panel(add_spaces_and_rules.debug)
runmj = CSharpScript(
    main=add_spaces_and_rules.main,
    space="space",
    ruleset="walker",
    maxOperations=number_slider,
    seed=number_slider_2,
    refresh=refresh_2)  # -> debug, main
# ---------- runmj: C# ----------
// Grasshopper Script Instance
#region Usings
using System;
#r "C:\Users\Drew\Desktop\Projects\Dev\MJ Proc Gen\MJ Proc Gen\bin\Debug\netstandard2.0\MJ_Proc_Gen.dll"
using System.Linq;
using System.Collections;
using System.Collections.Generic;
using System.Drawing;

using Rhino;
using Rhino.Geometry;

using Grasshopper;
using Grasshopper.Kernel;
using Grasshopper.Kernel.Data;
using Grasshopper.Kernel.Types;

using MJ_Proc_Gen;
#endregion

public class Script_Instance : GH_ScriptInstance
{
    private void RunScript(
	object _main,
	object _space,
	object _ruleset,
	object _maxOperations,
	object _seed,
	object _refresh,
	ref object debug,
	ref object main)
    {
        MJ_Main m = (MJ_Main) _main;
        string space = (string)_space;
        string ruleset = (string)_ruleset;
        int maxOps = Convert.ToInt32(_maxOperations);
        int seed = Convert.ToInt32(_seed);
        m.RunMJ(space, ruleset, maxOps, seed);
        main = m;
        debug = m.debug.DebugText;
    }
}
# ---------- end runmj ----------
subtraction = Subtraction(A=frame_100, B=1)
output_state_frames = CSharpScript(main=runmj.main, space="space", frame=subtraction)  # -> totalFrames, frame, framePlanes
# ---------- output_state_frames: C# ----------
// Grasshopper Script Instance
#region Usings
using System;
#r "C:\Users\Drew\Desktop\Projects\Dev\MJ Proc Gen\MJ Proc Gen\bin\Debug\netstandard2.0\MJ_Proc_Gen.dll"
using System.Linq;
using System.Collections;
using System.Collections.Generic;
using System.Drawing;

using Rhino;
using Rhino.Geometry;

using Grasshopper;
using Grasshopper.Kernel;
using Grasshopper.Kernel.Data;
using Grasshopper.Kernel.Types;

using MJ_Proc_Gen;
#endregion

public class Script_Instance : GH_ScriptInstance
{
    private void RunScript(
	object _main,
	object _space,
	object _frame,
	ref object totalFrames,
	ref object frame,
	ref object framePlanes)
    {
        MJ_Main m = (MJ_Main)_main;
        int f = Convert.ToInt32(_frame);
        string s = (string)_space;
        string[] frameStrings = m.Spaces[s].SpaceStateOutput.Split('&');
        string[] planes = frameStrings[f].Split('/');
        frame = frameStrings[f];
        framePlanes = planes;
        totalFrames = frameStrings.Length;
    }
}
# ---------- end output_state_frames ----------
opcount = CSharpScript(main=runmj.main, space="space")  # -> opCount
# ---------- opcount: C# ----------
// Grasshopper Script Instance
#region Usings
using System;
#r "C:\Users\Drew\Desktop\Projects\Dev\MJ Proc Gen\MJ Proc Gen\bin\Debug\netstandard2.0\MJ_Proc_Gen.dll"
using System.Linq;
using System.Collections;
using System.Collections.Generic;
using System.Drawing;

using Rhino;
using Rhino.Geometry;

using Grasshopper;
using Grasshopper.Kernel;
using Grasshopper.Kernel.Data;
using Grasshopper.Kernel.Types;
using MJ_Proc_Gen;
#endregion

public class Script_Instance : GH_ScriptInstance
{
    private void RunScript(object _main, object _space, ref object opCount)
    {
        MJ_Main m = (MJ_Main)_main;
        string spaceName = (string)_space;
        opCount = m.Spaces[spaceName].OpCount;
    }
}
# ---------- end opcount ----------
panel_8 = Panel(runmj.debug)
pt = Point(<point referenced from the Rhino model>)
geo = Geometry()
geo_2 = Geometry(<extrusion referenced from the Rhino model>)
pt_2 = Point(<point referenced from the Rhino model>)
geo_3 = Geometry(<extrusion referenced from the Rhino model>)
pt_3 = Point(<point referenced from the Rhino model>)
geo_4 = Geometry(<brep referenced from the Rhino model>)
pt_4 = Point(<point referenced from the Rhino model>)
geo_5 = Geometry(<surface referenced from the Rhino model>)
sample = Sample(refname="O", refpoint=pt, geom=geo)
sample_2 = Sample(refname="G", refpoint=pt, geom=geo_2)
sample_3 = Sample(refname="T", refpoint=pt_2, geom=geo_3)
sample_4 = Sample(refname="S", refpoint=pt_3, geom=geo_4)
sample_5 = Sample(refname="L", refpoint=pt_4, geom=geo_5)
frame = Panel(output_state_frames.framePlanes)
merge_2 = Merge(Data1=sample, Data2=sample_2, Data3=sample_3, Data4=sample_4, Data5=sample_5)
model_frame = CSharpScript(
    frame=output_state_frames.frame,
    xSize=number_slider_4,
    ySize=number_slider_5,
    zSize=number_slider_3,
    spacing=Slider(10, range=0..10),
    samples=merge_2)  # -> geometry; inputs samples: list
# ---------- model_frame: C# ----------
// Grasshopper Script Instance
#region Usings
using System;
#r "C:\Users\Drew\Desktop\Projects\Dev\MJ Proc Gen\MJ Proc Gen\bin\Debug\netstandard2.0\MJ_Proc_Gen.dll"
using System.Linq;
using System.Collections;
using System.Collections.Generic;
using System.Drawing;

using Rhino;
using Rhino.Geometry;

using Grasshopper;
using Grasshopper.Kernel;
using Grasshopper.Kernel.Data;
using Grasshopper.Kernel.Types;

using MJ_Proc_Gen;
#endregion

public class Script_Instance : GH_ScriptInstance
{
    private void RunScript(
	object _frame,
	object _xSize,
	object _ySize,
	object _zSize,
	object _spacing,
	List<object> _samples,
	ref object geometry)
    {
        string frame = (string)_frame;
        int xSize = Convert.ToInt32(_xSize);
        int ySize = Convert.ToInt32(_ySize);
        int zSize = Convert.ToInt32(_zSize);
        int sp = Convert.ToInt32(_spacing);
        //List<Point3d> pts = new List<Point3d>();
        List<GeometryBase> geoms = new List<GeometryBase>();
        Dictionary<string, Sample> samples = new Dictionary<string, Sample>();
        List<object> oList = (List<object>)_samples;
        for (int i = 0; i < oList.Count; i += 3)
        {
            Sample s = new Sample((string)oList[i], (Point3d)oList[i + 1], (GeometryBase)oList[i + 2]);
            samples.Add(s.refName, s);
        }
        for (int x = 0; x < xSize; x++)
        {
            for (int y = 0; y < ySize; y++)
            {
                for (int z = 0; z < zSize; z++)
                {
                    Point3d p = new Point3d(x*sp, y*sp, z*sp);
                    //pts.Add(p);
                    string key = Item(x, Row(y, Plane(z, frame)));
                    Sample s = samples[key];
                    if (s.geom != null)
                    {
                        GeometryBase g = s.geom.Duplicate();
                        g.Translate(p.X - s.refPoint.X, p.Y - s.refPoint.Y, p.Z - s.refPoint.Z);
                        geoms.Add(g);
                    }
                }
            }   
        }
        geometry = geoms;
    }
    public struct Sample
    {
        public string refName;
        public Point3d refPoint;
        public GeometryBase geom;
        public Sample(string rn, Point3d rp, GeometryBase g)
        {
            this.refName = rn;
            this.refPoint = rp;
            this.geom = g;
        }
    }
    public string Plane(int i, string frame)
    {
        return frame.Split('/')[i];
    }
    public string Row(int i, string plane)
    {
        return plane.Split(';')[i];        
    }
    public string Item(int i, string row)
    {
        return row.Split(',')[i];
    }
}
# ---------- end model_frame ----------
lng = ListLength(List=model_frame)

operations = Panel(opcount)
frames = Panel(output_state_frames.totalFrames)
total_geometry = Panel(lng)

geo_6 = Geometry(model_frame)
material = CreateMaterial(
    Diffuse=ColourSwatch(SwatchColor=RGB(184, 42, 174)),
    Specular=RGB(255, 255, 255),
    Emission=RGB(0, 0, 0),
    Transparency=0,
    Shine=0)
preview = CustomPreview(Geometry=geo_6, Material=material)

# ==== cluster Sample
refname = ClusterInput()
refpoint = ClusterInput()
geom = ClusterInput()
sample = CSharpScript(refName=refname, refPoint=refpoint, geom=geom)  # -> sample
# ---------- sample: C# ----------
// Grasshopper Script Instance
#region Usings
using System;
using System.Linq;
using System.Collections;
using System.Collections.Generic;
using System.Drawing;

using Rhino;
using Rhino.Geometry;

using Grasshopper;
using Grasshopper.Kernel;
using Grasshopper.Kernel.Data;
using Grasshopper.Kernel.Types;
#endregion

public class Script_Instance : GH_ScriptInstance
{
    #region Notes
    /* 
      Members:
        RhinoDoc RhinoDocument
        GH_Document GrasshopperDocument
        IGH_Component Component
        int Iteration

      Methods (Virtual & overridable):
        Print(string text)
        Print(string format, params object[] args)
        Reflect(object obj)
        Reflect(object obj, string method_name)
    */
    #endregion

    private void RunScript(
	object _refName,
	object _refPoint,
	object _geom,
	ref object sample)
    {
        //string rn = (string)_refName;
        //Point3d rp = (Point3d)_refPoint;
        //GH_GeometryGroup g = (GH_GeometryGroup)_geom;
        List<object> list = new List<object>();
        list.Add(_refName);
        list.Add(_refPoint);
        list.Add(_geom);
        sample = list;
    }
}
# ---------- end sample ----------
sample_2 = ClusterOutput(sample)
